# Grasshopper definition Metaballs Sculpting.gh (Grasshopper 1.0.7)

O = Origin(Point(-100.13088, 8.203424412, 0))
yz = YZPlane(Origin=O)
vec = VectorXYZ(XComponent=Slider(-0.86, range=-150..50), YComponent=Slider(70, range=0..150), ZComponent=Slider(27.8, range=0..50))  # -> Vector, Length
number_slider = Slider(0.2, range=0..2)
move = Move(Geometry=yz, Motion=vec.Vector)  # -> Geometry, Transform
number_slider_2 = Slider(0.1, range=-1..1)
number_slider_3 = Slider(0, range=-1..1)
recgrid = Rectangular(
    Plane=move.Geometry,
    SizeX=number_slider,
    SizeY=number_slider,
    ExtentX=Slider(305, range=0..1000),
    ExtentY=Slider(725, range=0..1000))  # -> Cells, Points
number_slider_4 = Slider(-0.7, range=-1..1)
pt = Point([<point referenced from the Rhino model> x4])
number_slider_5 = Slider(-0.2, range=-1..1)
item = ListItem(List=pt, Index="1", Wrap=True)
vec_2 = VectorXYZ(XComponent=Slider(-0.1, range=-5..1), YComponent=number_slider_2, ZComponent=number_slider_3)  # -> Vector, Length
number_slider_6 = Slider(-0.4, range=-1..1)
number_slider_7 = Slider(-0.5, range=-1..1)
X = UnitX(Factor=Slider(-0.42, range=-1..1))
move_2 = Move(Geometry=item, Motion=vec_2.Vector)  # -> Geometry, Transform
item_2 = ListItem(List=pt, Index="2", Wrap=True)
vec_3 = VectorXYZ(XComponent=0, YComponent=number_slider_4, ZComponent=number_slider_5)  # -> Vector, Length
arrlinear = LinearArray(Geometry=yz, Direction=X, Count=Slider(10, range=0..40))  # -> Geometry, Transform
genes = GenePool(Decimals=1, Maximum=20, Minimum=0, Value=[0.8, 0.4, 7, 1.5])
move_3 = Move(Geometry=item_2, Motion=vec_3.Vector)  # -> Geometry, Transform
item_3 = ListItem(List=pt, Index="3", Wrap=True)
vec_4 = VectorXYZ(XComponent=0, YComponent=number_slider_6, ZComponent=number_slider_7)  # -> Vector, Length
vec_5 = VectorXYZ(XComponent=0, YComponent=Slider(-0.4, range=-1..1), ZComponent=Slider(-0.7, range=-1..1))  # -> Vector, Length
item_4 = ListItem(List=pt, Index="4", Wrap=True)
move_4 = Move(Geometry=item_3, Motion=vec_4.Vector)  # -> Geometry, Transform
move_5 = Move(Geometry=item_4, Motion=vec_5.Vector)  # -> Geometry, Transform
galapagos = Galapagos(
    fitness=addition,
    gene=[genes, number_slider_2, number_slider_3, number_slider_4, number_slider_5, number_slider_6, number_slider_7])
number_slider_8 = Slider(10, range=0..100)
metaball_t = MetaBallTCustom(
    Points=[move_2.Geometry, move_3.Geometry, move_4.Geometry, move_5.Geometry],
    Charge=genes,
    Plane=arrlinear.Geometry,
    Threshold=Slider(0.3, range=0..1),
    Accuracy=Slider(0.3, range=0..1))  # -> simplify(flatten(Isocurve))
crv = Curve(<curve referenced from the Rhino model>)
item_5 = ListItem(List=metaball_t, Index=0, Wrap=True)
division = Division(A=number_slider_8, B=Slider(2, range=0..10))
number_slider_9 = Slider(5, range=0..10)
number_slider_10 = Slider(6, range=0..10)
number_slider_11 = Slider(4, range=0..10)
number_slider_12 = Slider(8, range=0..10)
divide = DivideCurve(Curve=crv, Count=number_slider_8, Kinks=False)  # -> Points, Tangents, Parameters
divide_2 = DivideCurve(Curve=item_5, Count=division, Kinks=False)  # -> Points, Tangents, Parameters
crv_2 = Curve(metaball_t)
mirror = Mirror(Geometry=crv_2, Plane=[O, move.Geometry])  # -> Geometry, Transform
item_6 = ListItem(Index=Slider(1, range=0..100), Wrap=True)
item_7 = ListItem(Index=Slider(4, range=0..100), Wrap=True)
item_8 = ListItem(Index=Slider(3, range=0..100), Wrap=True)
item_9 = ListItem(Index=Slider(0, range=0..100), Wrap=True)
item_10 = ListItem(Index=Slider(2, range=0..100), Wrap=True)
item_11 = ListItem(Index=Slider(5, range=0..100), Wrap=True)
item_12 = ListItem(List=divide_2.Points, Index=number_slider_9, Wrap=True)
item_13 = ListItem(List=divide.Points, Index=number_slider_9, Wrap=True)
item_14 = ListItem(List=divide_2.Points, Index=number_slider_10, Wrap=True)
item_15 = ListItem(List=divide.Points, Index=number_slider_10, Wrap=True)
item_16 = ListItem(List=divide_2.Points, Index=number_slider_11, Wrap=True)
item_17 = ListItem(List=divide.Points, Index=number_slider_11, Wrap=True)
item_18 = ListItem(List=divide_2.Points, Index=number_slider_12, Wrap=True)
item_19 = ListItem(List=divide.Points, Index=number_slider_12, Wrap=True)
dist = Distance(PointA=item_16, PointB=item_17)
dist_2 = Distance(PointA=item_12, PointB=item_13)
ln = Line(StartPoint=item_14, EndPoint=item_15)
ln_2 = Line(StartPoint=item_16, EndPoint=item_17)
dist_3 = Distance(PointA=item_14, PointB=item_15)
ln_3 = Line(StartPoint=item_12, EndPoint=item_13)
dist_4 = Distance(PointA=item_18, PointB=item_19)
ln_4 = Line(StartPoint=item_18, EndPoint=item_19)
num = Number(dist_3)
num_2 = Number(dist_2)
num_3 = Number(dist)
num_4 = Number(dist_4)
addition = Addition(A=num_2, B=num, C=num_3, D=num_4)
panel = Panel(addition)
